# Grasshopper definition util_script_locline_generator.gh (Grasshopper 1.0.8)

list = ValueList({"Metal": 0, "Plastic": 1}, selected="Metal")

# ---- group: curve
crv = Curve(<curve referenced from the Rhino model>)

# ----
cluster = Cluster(locline_type=list, num=Slider(0.634, range=0..1), crv=crv)
geo = Geometry(cluster)
geo_2 = Geometry([<mesh referenced from the Rhino model> x2])
swatch = ColourSwatch(SwatchColor=RGBA(255, 255, 255, 80))
swatch_2 = ColourSwatch(SwatchColor=RGBA(255, 255, 255, 80))
preview = CustomPreview(Geometry=geo, Material=ColourSwatch(SwatchColor=RGB(255, 255, 255)))
preview_2 = CustomPreview(Geometry=geo_2, Material=ColourSwatch(SwatchColor=RGB(235, 235, 235)))

# ==== cluster Cluster
locline_type = ClusterInput()

# ---- group: Metal
geo = Geometry(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)

# ---- group: Plastic
geo_2 = Geometry(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)

# ----
merge = Merge(Data1=geo, Data2=geo_2)
item = ListItem(List=merge, Index=locline_type, Wrap=True)
num = ClusterInput()
crv = ClusterInput()
geo_3 = Geometry(item)
num_2 = Number(num)
crv_2 = Curve(crv)

# ---- group: Scale
xy = XYPlane(Origin=Point(0, 0, 0))
scale = Scale(Geometry=geo_3, Center=xy, Factor=num_2)  # -> Geometry, Transform

# ----
geo_4 = Geometry(scale.Geometry)

# ---- group: Get_plot_height
bbox = BoundingBox(Content=scale.Geometry, Plane=PlaneXY(0, 0, 0))  # -> Box, Box_2
debrep = DeconstructBrep(Brep=bbox.Box)  # -> Faces, Edges, Vertices
pdecon = Deconstruct(Point=debrep.Vertices)  # -> XComponent, YComponent, ZComponent
sort = SortList(Keys=pdecon.ZComponent, ValuesA=debrep.Vertices)  # -> Keys, ValuesA
item_2 = ListItem(List=reverse(sort.Keys), Index=0, Wrap=True)

# ----
geo_5 = Geometry(geo_4)

# ---- group: Ratio closness
height_plot = Panel(item_2)
closness = Panel("64")
division = Division(A=height_plot, B=100)
multiplication = Multiplication(A=division, B=closness)

# ----
num_height_plot = Number(multiplication)

# ---- group: curve_target_vectors
divlength = DivideLength(Curve=crv_2, Length=num_height_plot)  # -> simplify(Points), Tangents, Parameters
crv_3 = Curve(crv_2)
end = EndPoints(Curve=crv_3)  # -> Start, End
cull_i = CullIndex(List=divlength.Points, Indices="0", Wrap=True)
pt = Point(end.End)
merge_2 = Merge(Data1=cull_i, Data2=pt)  # -> simplify(flatten(Result))
shift = ShiftList(List=merge_2, Shift=1, Wrap=True)
pt_2 = Point(divlength.Points)
pt_3 = Point(shift)
vec2pt = Vector2Pt(PointA=pt_2, PointB=pt_3, Unitize=False)  # -> Vector, Length
vdis = VectorDisplay(Anchor=pt_2, Vector=vec2pt.Vector)

# ---- group: origin_vector
Z = UnitZ(Factor=num_height_plot)
pt_origin = Point("0,0,0")
move = Move(Geometry=pt_origin, Motion=Z)  # -> Geometry, Transform
vec2pt_2 = Vector2Pt(PointA=pt_origin, PointB=divlength.Points, Unitize=False)  # -> Vector, Length

# ---- group: VectorMoved
move_2 = Move(Geometry=pt_origin, Motion=vec2pt_2.Vector)  # -> Geometry, Transform
Z_2 = UnitZ(Factor=num_height_plot)
move_3 = Move(Geometry=move_2.Geometry, Motion=Z_2)  # -> Geometry, Transform
vec2pt_3 = Vector2Pt(PointA=move_2.Geometry, PointB=move_3.Geometry, Unitize=False)  # -> Vector, Length
vdis_2 = VectorDisplay(Anchor=move_2.Geometry, Vector=vec2pt_3.Vector)

# ---- group: MovedGeo
move_4 = Move(Geometry=geo_5, Motion=vec2pt_2.Vector)  # -> Geometry, Transform

# ----
orient = OrientDirection(Geometry=move_4.Geometry, PointA=divlength.Points, DirectionA=vec2pt_3.Vector, PointB=pt_2, DirectionB=vec2pt.Vector)  # -> Geometry, Transform
G = ClusterOutput(orient.Geometry)
