# Grasshopper definition example_replayer.gh (Grasshopper 1.0.8)
# plug-ins: RhinoCodePluginGH

panel = Panel("MAUM")
panel_2 = Panel("TRSE")
acpy_replayer_initializer = AcpyReplayerInitializer(
    i_log_root_path="D:\\tesst_replayer_live\\logs",
    i_exp_id="PER1",
    i_ttool_download_path="D:\\tesst_replayer_live\\ttooldataset")  # -> o_replayer, o_frame_count, o_exp_id; inputs i_log_root_path: String, i_exp_id: String, i_ttool_download_path: String, i_camera_model: GeometryBase
#   port i_log_root_path: The root path where the log files are stored.
#   port i_exp_id: The experiment id.
#   port i_ttool_download_path: The directory where the TTool models are downloaded.
#   port i_camera_model: Custom camera brep. If not provided, the default camera will be used. The camera brep should facing the positive z-axis.
#   port o_replayer: The initialized replayer object.
#   port o_frame_count: The total number of frames of the loaded log.
# ---------- acpy_replayer_initializer: Python ----------
"""Grasshopper Script Instance"""
import os

import System

import Rhino
import ghpythonlib
from ghpythonlib.componentbase import executingcomponent as component

# FOR DEBUG
import sys
sys.path.append("C:\\Users\\localuser\\Documents\\hong-bin\\replayer\\pypi")

import ACPy
from ACPy.replayer.replayer import Replayer

class ACPyReplayerInitializer(component):
    def __init__(self):
        super(ACPyReplayerInitializer, self).__init__()

    def RunScript(self,
            i_log_root_path: str,
            i_exp_id: str,
            i_ttool_download_path: str,
            i_camera_model: Rhino.Geometry.GeometryBase):
        replayer = Replayer()
        replayer.load(i_log_root_path, i_exp_id, i_ttool_download_path)

        if i_camera_model:
            replayer.set_camera_model(i_camera_model)

        return replayer, replayer.log_data.frame_count, i_exp_id
    
# if __name__ == "__main__":
#     replayer, frame_count = ACPyReplayerInitializer().RunScript(log_root_path, exp_id, ttool_download_path, camera_model)
# ---------- end acpy_replayer_initializer ----------
panel_3 = Panel(acpy_replayer_initializer.o_frame_count)
trse = Slider(65338, range=0..99339)
per1 = Slider(66715, range=0..237015)
number_slider = Slider(20184, range=0..125753)

# ----
# Display specific frame directly in Rhino
# Replayer without video
int = Integer(panel_3)
panel_4 = Panel(int)
run = BooleanToggle(False)
python = PythonScript(Run=run, i_end=panel_4, i_interval=Slider(1, range=1..1000), i_start=Slider(41222, range=0..125753))  # -> Counter; inputs Run: Boolean, i_start: Int32
# ---------- python: Python ----------
import Grasshopper as gh

def updateComponent(interval):
    
    """ Update this component similar to using a grasshopper timer """
    
    def callBack(e):
        ghenv.Component.ExpireSolution(False)
        
    ghenv.Component.OnPingDocument().ScheduleSolution(interval,
    gh.Kernel.GH_Document.GH_ScheduleDelegate(callBack))

# Instantiate or reset persistent counter variable
if "count" not in globals() or not Run:
    count = i_start


# Update the variable and component
if Run:
    if count < i_end:
        count +=1
        updateComponent(i_interval)
    elif count == i_end:
        count = 0

# Output counter
Counter = count
# ---------- end python ----------
panel_5 = Panel(python)

frame_value = Integer(per1)

# ----
# Set End Frame
dam = DataDam(DataA=frame_value, BufferDelay=10000000, BufferMode=0)

# ----
# Set Start Frame
dam_2 = DataDam(DataA=frame_value, BufferDelay=10000000, BufferMode=0)

acpy_replayer_scene_generator = AcpyReplayerSceneGenerator(i_replayer=acpy_replayer_initializer.o_replayer, i_frame_id=frame_value)  # -> o_camera_model, o_tool_model, o_tool_primitive_model, o_acim_bbox, o_acim_activated_component, o_acim_done_component, o_acim_not_done_component; inputs i_frame_id: Int32
#   port i_replayer: The initialized replayer object.
#   port i_frame_id: The target frame index.
#   port o_camera_model: Transformed camera brep.
#   port o_tool_model: Transformed tool model (Brep).
#   port o_tool_primitive_model: Transformed tool primitve model (Brep).
#   port o_acim_bbox: Transformed acim bounding box.
#   port o_acim_activated_component: Transformed acim activated component.
#   port o_acim_done_component: Transformed acim done component.
#   port o_acim_not_done_component: Transformed acim not done component.
# ---------- acpy_replayer_scene_generator: Python ----------
"""Grasshopper Script Instance"""
import System
import Rhino

import os
import Rhino
import ghpythonlib

import ACPy

class ACPyReplayerSceneGenerator(component):
    def __init__(self):
        super(ACPyReplayerSceneGenerator, self).__init__()

    def RunScript(self, i_replayer, i_frame_id: int):
        scene = i_replayer.generate_scene_at_frame(i_frame_id)

        camera_model = scene["camera_model"]
        tool_model = scene["tool_model"]
        tool_primitive_model = scene["tool_primitive_model"]
        acim_bbox = scene["acim_bbox"]
        acim_activated_component = scene["acim_activated_component"]
        acim_done_component = scene["acim_done_component"]
        acim_not_done_component = scene["acim_not_done_component"]

        return camera_model, tool_model, tool_primitive_model, acim_bbox, acim_activated_component, acim_done_component, acim_not_done_component

# if __name__ == "__main__":
#     camera_model, tool_model, tool_primitive_model, acim_bbox, acim_activated_component, acim_done_component, acim_not_done_component = \
#         ACPyReplayerSceneGenerator().RunScript(i_replayer, i_frame_id)
# ---------- end acpy_replayer_scene_generator ----------
o_tool_primitive_model = Geometry(acpy_replayer_scene_generator.o_tool_primitive_model)
o_tool_model = Geometry(acpy_replayer_scene_generator.o_tool_model)
geo = Geometry(acpy_replayer_scene_generator.o_camera_model)
txt = Text(acpy_replayer_initializer.o_exp_id)
geo_2 = Geometry(acpy_replayer_scene_generator.o_acim_bbox)

# ---- group: Timber_axis / vectors_build
cluster = Cluster(B=geo_2)  # -> pt_5, V, V_2, V_3

# ---- group: Camera_axis / vectors_build
cluster_2 = Cluster_2(G=geo, B=geo)  # -> pt_ctr_2, V, V_3, V_2

# ---- group: vectors_build_CIRCULARSAW
cluster_3 = Cluster_4(G=o_tool_primitive_model)  # -> pt_ctr_2, V_2, V_3, V

# ---- group: vectors_build_CHAINSAW
cluster_4 = Cluster_3(G=o_tool_model)  # -> pt_ctr_2, V, V_2, V_3

# ---- group: vectors_build_DRILLBIT
cluster_5 = Cluster_5(G=o_tool_primitive_model)  # -> C, V_2, V_3, V

# ----
py3 = Python3Script(
    i_str=txt,
    i_ctr_a=cluster_3.pt_ctr_2,
    i_v_1a=cluster_3.V_2,
    i_v_2a=cluster_3.V_3,
    i_v_3a=cluster_3.V,
    i_ctr_b=cluster_4.pt_ctr_2,
    i_v_1b=cluster_4.V,
    i_v_2b=cluster_4.V_2,
    i_v_3b=cluster_4.V_3,
    i_ctr_c=cluster_5.C,
    i_v_1c=cluster_5.V_2,
    i_v_2c=cluster_5.V_3,
    i_v_3c=cluster_5.V)  # -> out, o_ctr, o_v_1, o_v_2, o_v_3; inputs i_str: String, i_ctr_a: Point3d, i_v_1a: Vector3d, i_v_2a: Vector3d, i_v_3a: Vector3d, i_ctr_b: Point3d, i_v_1b: Vector3d, i_v_2b: Vector3d, i_v_3b: Vector3d, i_ctr_c: Point3d, i_v_1c: Vector3d, i_v_2c: Vector3d, i_v_3c: Vector3d
# ---------- py3: Python ----------
#! python3


if __name__ == "__main__":
    o_ctr = i_ctr_a
    o_v_1 = i_v_1a
    o_v_2 = i_v_2a
    o_v_3 = i_v_3a
    if i_str == "TRSE":
        o_ctr = i_ctr_b
        o_v_1 = i_v_1b
        o_v_2 = i_v_2b
        o_v_3 = i_v_3b
    elif "PER" in i_str:
        o_ctr = i_ctr_c
        o_v_1 = i_v_1c
        o_v_2 = i_v_2c
        o_v_3 = i_v_3c
# ---------- end py3 ----------

# ---- group: Toolhead_axis
vec = Vector(py3.o_v_1)
vec_2 = Vector(py3.o_v_2)
pt = Point(py3.o_ctr)
vec_3 = Vector(py3.o_v_3)
xy = Slider(0.235, range=0..1)
amp = Amplitude(Vector=vec_2, Amplitude=expr("x*-1", Slider(1.72, range=0..10)))
axis_camera = AXIS_camera(pt=pt, vec_x=vec, vec_y=vec_2, vec_z=vec_3, num=xy, num_2=Slider(2.496, range=0..10))
move = Move(Geometry=pt, Motion=amp)  # -> Geometry, Transform

# ---- group: Camera_axis
vec_4 = Vector(cluster_2.V_3)
pt_2 = Point(cluster_2.pt_ctr_2)
vec_5 = Vector(cluster_2.V)
vec_6 = Vector(cluster_2.V_2)
xy_2 = Slider(0.235, range=0..1)
amp_2 = Amplitude(Vector=vec_5, Amplitude=expr("x*-1", Slider(1.72, range=0..10)))
axis_camera_2 = AXIS_camera(pt=pt_2, vec_x=vec_4, vec_y=vec_5, vec_z=vec_6, num=xy_2, num_2=Slider(2.496, range=0..10))
move_2 = Move(Geometry=pt_2, Motion=amp_2)  # -> Geometry, Transform

# ---- group: Timber_axis
vec_7 = Vector(cluster.V)
pt_3 = Point(cluster.pt_5)
vec_8 = Vector(cluster.V_2)
vec_9 = Vector(cluster.V_3)
xy_3 = Slider(0.235, range=0..1)
amp_3 = Amplitude(Vector=vec_8, Amplitude=expr("x*-1", Slider(4.631, range=0..10)))
axis_camera_3 = AXIS_camera(pt=pt_3, vec_x=vec_8, vec_y=vec_7, vec_z=vec_9, num=xy_3, num_2=Slider(2.496, range=0..10))
move_3 = Move(Geometry=cluster.pt_5, Motion=amp_3)  # -> Geometry, Transform

# ----
entwine = Entwine(Branch00=move_2.Geometry, Branch01=move.Geometry, Branch02=move_3.Geometry, FlattenInputs=True)
entwine_2 = Entwine(Branch00=axis_camera_2, Branch01=axis_camera, Branch02=axis_camera_3, FlattenInputs=True)
brep = Brep(entwine_2)
panel_6 = Panel("""Cam
TCP
Timber""")
merge = Merge(
    Data1=ColourSwatch(SwatchColor=RGB(255, 0, 0)),
    Data2=ColourSwatch(SwatchColor=RGB(0, 255, 85)),
    Data3=ColourSwatch(SwatchColor=RGB(0, 68, 255)))
tag = TextTag(Location=entwine, Text=graft(panel_6), Colour=ColourSwatch(SwatchColor=RGB(255, 255, 255)))
preview = CustomPreview(Geometry=brep, Material=merge)

o_camera_model = Brep(acpy_replayer_scene_generator.o_camera_model)
bbox = BoundingBox(Content=o_camera_model, Plane=PlaneXY(0, 0, 0))  # -> Box, Box_2
area = Area(Geometry=bbox.Box)  # -> Area, Centroid

o_tool_primitive_model_2 = Brep(acpy_replayer_scene_generator.o_tool_primitive_model)
o_acim_bbox = Brep(acpy_replayer_scene_generator.o_acim_bbox)
o_acim_activated_component = Brep(acpy_replayer_scene_generator.o_acim_activated_component)
o_acim_done_component = Brep(acpy_replayer_scene_generator.o_acim_done_component)
o_camera_model_2 = Brep(o_camera_model)
o_acim_not_done_component = Brep(acpy_replayer_scene_generator.o_acim_not_done_component)
debrep = DeconstructBrep(Brep=o_acim_done_component)  # -> Faces, Edges, Vertices
debrep_2 = DeconstructBrep(Brep=o_acim_not_done_component)  # -> Faces, Edges, Vertices
debrep_3 = DeconstructBrep(Brep=o_acim_activated_component)  # -> Faces, Edges, Vertices
debrep_4 = DeconstructBrep(Brep=o_acim_bbox)  # -> Faces, Edges, Vertices
preview_2 = CustomPreview(Geometry=acpy_replayer_scene_generator.o_tool_model, Material=ColourSwatch(SwatchColor=RGBA(0, 89, 255, 127)))
preview_3 = CustomPreview(Geometry=debrep_3.Faces, Material=ColourSwatch(SwatchColor=RGBA(0, 128, 11, 74)))
preview_4 = CustomPreview(Geometry=debrep.Faces, Material=ColourSwatch(SwatchColor=RGBA(41, 41, 41, 159)))
preview_5 = CustomPreview(Geometry=debrep_2.Faces, Material=ColourSwatch(SwatchColor=RGBA(255, 132, 0, 74)))
preview_6 = CustomPreview(Geometry=debrep_4.Edges, Material=ColourSwatch(SwatchColor=RGBA(221, 0, 255, 165)))
preview_7 = CustomPreview(Geometry=o_camera_model_2, Material=ColourSwatch(SwatchColor=RGBA(255, 0, 0, 54)))

o_acim_activated_component_2 = Geometry(acpy_replayer_scene_generator.o_acim_activated_component)
o_tool_model_2 = Geometry(acpy_replayer_scene_generator.o_tool_model)
o_tool_primitive_model_3 = Geometry(acpy_replayer_scene_generator.o_tool_primitive_model)
py3_2 = Python3Script(o_b=o_tool_model_2, o_b_primitive=o_tool_primitive_model_3)  # -> out, o_x_model
# ---------- py3_2: Python ----------
#! python3

if __name__ == "__main__":
    o_x_model = o_b
    if o_b_primitive is not None:
        o_x_model = o_b_primitive
# ---------- end py3_2 ----------
bbx = BrepBrep(BrepA=o_acim_activated_component_2, BrepB=py3_2.o_x_model)  # -> Curves, Points

entwine_3 = Entwine(Branch00=area.Centroid, Branch01=bbx.Curves, FlattenInputs=True)
rec = DataRecorder(entwine_3, DataLimit=-300, RecordData=True)
bang = ExplodeTree(Data=rec)  # -> Branch0, Branch1

py3_3 = Python3Script(cam_points=bang.Branch0)  # -> out, lines, color_param; inputs cam_points: list of Point3d
# ---------- py3_3: Python ----------
import Rhino 
 
MAX_SEG_N = 300
color_step = 1 / (MAX_SEG_N - 1) 

cam_points.reverse()

# filtered duplicate points
filtered_points = [cam_points[0]]
for i in range(1, len(cam_points)):
    if cam_points[i].DistanceTo(filtered_points[-1]) < 1e-3:
        continue
    filtered_points.append(cam_points[i])
cam_points = filtered_points

lines = [] 
color_param = [] 
n = len(cam_points)

if n >= 2:
    if n > MAX_SEG_N: 
        for i in range(1, MAX_SEG_N):
            lines.append(Rhino.Geometry.Polyline(cam_points[i-1:i+1]))
            color_param.append(color_step * i)
        
        i = MAX_SEG_N
        lines.append(Rhino.Geometry.Polyline(cam_points[i-1:]))
        color_param.append(color_step * i)

    else: 
        for i in range(1, n):
            print(cam_points[i-1], "->", cam_points[i])
            lines.append(Rhino.Geometry.Polyline(cam_points[i-1:i+1]))
            color_param.append(color_step * i)
# ---------- end py3_3 ----------
data = Data(py3_3.color_param)
geo_3 = Geometry(py3_3.lines)
multiplication = Multiplication(A=data, B=3)
gradient = Gradient(
    LowerLimit=1,
    UpperLimit=0,
    Parameter=multiplication,
    stops=[0.1: RGB(16, 110, 75), 0.222: RGB(34, 161, 91), 0.485: RGB(242, 255, 0), 0.759: RGB(255, 128, 0), 1: RGB(255, 0, 0)])
preview_8 = CustomPreview(Geometry=geo_3, Material=gradient)

preview_9 = CustomPreview(Geometry=bang.Branch1, Material=ColourSwatch(SwatchColor=RGB(0, 255, 238)))

# ----
# Test, try to get rid of
# long jumpy lines
py3_4 = Python3Script(i_lines=py3_3.lines, i_clrs=py3_3.color_param)  # -> out, o_lines, o_clrs; inputs i_lines: list of Line, i_clrs: list; disabled
# ---------- py3_4: Python ----------
#! python3

new_ln_lst = []
new_clr_lst = []
for idx, ln in enumerate(i_lines):
    if ln.Length < 5:
        new_ln_lst.append(ln)
        new_clr_lst.append(i_clrs[idx])

o_lines = new_ln_lst
o_clrs = new_clr_lst
# ---------- end py3_4 ----------

# ==== cluster AXIS_camera
pt = ClusterInput()
vec_x = ClusterInput()
vec_y = ClusterInput()
vec_z = ClusterInput()
num = ClusterInput()
num_2 = ClusterInput()
pt_2 = Point(pt)
vec_x_2 = Vector(vec_x)
vec_y_2 = Vector(vec_y)
vec_z_2 = Vector(vec_z)
num_3 = Number(num)
num_4 = Number(num_2)
pl_x = ConstructPlane(Origin=pt_2, XAxis=vec_x_2, YAxis=vec_y_2)
pl_y = ConstructPlane(Origin=pt_2, XAxis=vec_y_2, YAxis=vec_z_2)
pl_z = ConstructPlane(Origin=pt_2, XAxis=vec_z_2, YAxis=vec_x_2)
box_y = Box_X(pln=pl_y, num=num_3, num_2=num_4)
box_x = Box_X(pln=pl_x, num=num_3, num_2=num_4)
box_z = Box_X(pln=pl_z, num=num_3, num_2=num_4)
entwine = Entwine(Branch00=box_x, Branch01=box_y, Branch02=box_z, FlattenInputs=True)  # -> flatten(Result)
R = ClusterOutput(entwine)

# ==== cluster Cluster
B = ClusterInput()
debrep = DeconstructBrep(Brep=B)  # -> Faces, Edges, Vertices
item = ListItem(List=debrep.Vertices, Index="6", Wrap=True)  # -> Item, Item1
item_2 = ListItem(List=debrep.Vertices, Index="2", Wrap=True)
item_3 = ListItem(List=debrep.Vertices, Index="5", Wrap=True)
pt = Point(item.Item)
pt_2 = Point(item.Item1)
pt_3 = Point(item_2)
pt_4 = Point(item_3)
vec2pt = Vector2Pt(PointA=pt, PointB=pt_3, Unitize=False)  # -> Vector, Length
vec2pt_2 = Vector2Pt(PointA=pt, PointB=pt_2, Unitize=False)  # -> Vector, Length
vec2pt_3 = Vector2Pt(PointA=pt, PointB=pt_4, Unitize=False)  # -> Vector, Length
pt_5 = ClusterOutput(pt)
V = ClusterOutput(vec2pt.Vector)
V_2 = ClusterOutput(vec2pt_2.Vector)
V_3 = ClusterOutput(vec2pt_3.Vector)

# ==== cluster Cluster_2
G = ClusterInput()
B = ClusterInput()
volume = Volume(Geometry=G)  # -> Volume, Centroid
debrep = DeconstructBrep(Brep=B)  # -> Faces, Edges, Vertices
item = ListItem(List=debrep.Faces, Index="4", Wrap=True)
item_2 = ListItem(List=debrep.Faces, Index="2", Wrap=True)
pt_ctr = Point(volume.Centroid)
area = Area(Geometry=item)  # -> Area, Centroid
area_2 = Area(Geometry=item_2)  # -> Area, Centroid
pt_ctr_2 = ClusterOutput(pt_ctr)
vec2pt = Vector2Pt(PointA=pt_ctr, PointB=area.Centroid, Unitize=False)  # -> Vector, Length
vec2pt_2 = Vector2Pt(PointA=pt_ctr, PointB=area_2.Centroid, Unitize=False)  # -> Vector, Length
xprod = CrossProduct(VectorA=vec2pt.Vector, VectorB=vec2pt_2.Vector, Unitize=False)  # -> Vector, Length
V = ClusterOutput(vec2pt.Vector)
V_2 = ClusterOutput(vec2pt_2.Vector)
V_3 = ClusterOutput(xprod.Vector)

# ==== cluster Cluster_3
G = ClusterInput()
volume = Volume(Geometry=G)  # -> Volume, Centroid
debrep = DeconstructBrep(Brep=G)  # -> Faces, Edges, Vertices
item = ListItem(List=debrep.Faces, Index="3", Wrap=True)
pt_ctr = Point(volume.Centroid)
item_2 = ListItem(List=debrep.Faces, Index="4", Wrap=True)
debrep_2 = DeconstructBrep(Brep=item)  # -> Faces, Edges, Vertices
area = Area(Geometry=item_2)  # -> Area, Centroid
item_3 = ListItem(List=debrep_2.Edges, Index="3", Wrap=True)
curvepoint = PointOnCurve(item_3, parameter=0)
vec2pt = Vector2Pt(PointA=pt_ctr, PointB=area.Centroid, Unitize=False)  # -> Vector, Length
vec2pt_2 = Vector2Pt(PointA=pt_ctr, PointB=curvepoint, Unitize=False)  # -> Vector, Length
xprod = CrossProduct(VectorA=vec2pt.Vector, VectorB=vec2pt_2.Vector, Unitize=False)  # -> Vector, Length
V = ClusterOutput(vec2pt.Vector)
V_2 = ClusterOutput(xprod.Vector)
pt_ctr_2 = ClusterOutput(pt_ctr)
V_3 = ClusterOutput(vec2pt_2.Vector)

# ==== cluster Cluster_4
G = ClusterInput()
volume = Volume(Geometry=G)  # -> Volume, Centroid
debrep = DeconstructBrep(Brep=G)  # -> Faces, Edges, Vertices
item = ListItem(List=debrep.Faces, Index="4", Wrap=True)
item_2 = ListItem(List=debrep.Faces, Index="2", Wrap=True)
pt_ctr = Point(volume.Centroid)
curvepoint = PointOnCurve(item_2, parameter=0.225)
area = Area(Geometry=item)  # -> Area, Centroid
area_2 = Area(Geometry=item_2)  # -> Area, Centroid
vec2pt = Vector2Pt(PointA=pt_ctr, PointB=curvepoint, Unitize=False)  # -> Vector, Length
vec2pt_2 = Vector2Pt(PointA=pt_ctr, PointB=area.Centroid, Unitize=False)  # -> Vector, Length
xprod = CrossProduct(VectorA=vec2pt_2.Vector, VectorB=vec2pt.Vector, Unitize=False)  # -> Vector, Length
V = ClusterOutput(vec2pt.Vector)
V_2 = ClusterOutput(xprod.Vector)
V_3 = ClusterOutput(vec2pt_2.Vector)
pt_ctr_2 = ClusterOutput(pt_ctr)

# ==== cluster Cluster_5
G = ClusterInput()
debrep = DeconstructBrep(Brep=G)  # -> Faces, Edges, Vertices
volume = Volume(Geometry=G)  # -> Volume, Centroid
item = ListItem(List=debrep.Edges, Index="1", Wrap=True)
item_2 = ListItem(List=debrep.Faces, Index="4", Wrap=True)
item_3 = ListItem(List=debrep.Faces, Index="2", Wrap=True)
pt_ctr = Point(volume.Centroid)
midpt = CurveMiddle(Curve=item)
area = Area(Geometry=item_2)  # -> Area, Centroid
area_2 = Area(Geometry=item_3)  # -> Area, Centroid
vec2pt = Vector2Pt(PointA=pt_ctr, PointB=area.Centroid, Unitize=False)  # -> Vector, Length
vec2pt_2 = Vector2Pt(PointA=pt_ctr, PointB=midpt, Unitize=False)  # -> Vector, Length
xprod = CrossProduct(VectorA=vec2pt.Vector, VectorB=vec2pt_2.Vector, Unitize=False)  # -> Vector, Length
V = ClusterOutput(vec2pt_2.Vector)
V_2 = ClusterOutput(xprod.Vector)
V_3 = ClusterOutput(vec2pt.Vector)
C = ClusterOutput(area.Centroid)
vdis = VectorDisplay(Anchor=pt_ctr, Vector=vec2pt_2.Vector)
vdis_2 = VectorDisplay(Anchor=pt_ctr, Vector=vec2pt.Vector)
vdis_3 = VectorDisplay(Anchor=pt_ctr, Vector=xprod.Vector)

# ==== cluster Box_X
pln = ClusterInput()
num = ClusterInput()
num_2 = ClusterInput()
pln_2 = Plane(pln)
num_3 = Number(num)
num_4 = Number(num_2)
division = Division(A=num_3, B="2")
dom = ConstructDomain(DomainStart=division, DomainEnd=expr("x*-1", division))
dom_2 = ConstructDomain(DomainStart="0", DomainEnd=num_4)
box = DomainBox(Base=pln_2, X=dom, Y=dom, Z=dom_2)
brep = Brep(box)
brep_2 = ClusterOutput(brep)
