# Grasshopper definition faced.gh (Grasshopper 1.0.8)

number_slider = Slider(6050, range=0..10000)
crv_lt = Curve(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)
Y = UnitY(Factor=number_slider)
X = UnitX(Factor=number_slider)
range = Range(Domain=Domain(0, 1), Steps=Slider(12, range=0..100))
move = Move(Geometry=crv_lt, Motion=Y)  # -> Geometry, Transform
crv_rt = Curve(<curve referenced from the Rhino model>)
graph = GraphMapper(
    range,
    x0=0,
    x1=1,
    y0=0,
    y1=1,
    container_name="Bezier",
    cpx=[0, 0.6743964553, 0.3828505278, 1],
    cpy=[0, 0.3466179967, 0.6504828334, 1])
graph_2 = GraphMapper(
    range,
    x0=0,
    x1=1,
    y0=0,
    y1=1,
    container_name="Bezier",
    cpx=[0, 0.4196519852, 0.5465176702, 1],
    cpy=[0, 0.7495166063, 0.2772942185, 1])
graph_3 = GraphMapper(
    range,
    x0=0,
    x1=1,
    y0=0,
    y1=1,
    container_name="Bezier",
    cpx=[0, 0.4072142541, 0.5509953499, 1],
    cpy=[0, 0.654830277, 0.2647337914, 1])
graph_4 = GraphMapper(
    range,
    x0=0,
    x1=1,
    y0=0,
    y1=1,
    container_name="Bezier",
    cpx=[0, 0.4196519852, 0.5465176702, 1],
    cpy=[0, 0.7495166063, 0.2772942185, 1])
entwine = Entwine(Branch00=crv_lt, Branch01=move.Geometry, FlattenInputs=True)
entwine_2 = Entwine(Branch00=graph, Branch01=graph_3, FlattenInputs=True)
divlength = DivideLength(Curve=entwine)  # -> Points, Tangents, Parameters; disabled
eval = EvaluateLength(Curve=entwine, Length=entwine_2, Normalized=Toggle(True))  # -> Point, Tangent, Parameter
cull_i = CullIndex(List=eval.Point, Indices="0", Wrap=True)
panel = Panel("""0
-1""")
cull_i_2 = CullIndex(List=cull_i, Indices=panel, Wrap=True)
bang = ExplodeTree(Data=eval.Point)  # -> Branch0, Branch1
ln = Line(StartPoint=bang.Branch0, EndPoint=bang.Branch1)
crv = Curve(simplify(ln))
pframe = PerpFrame(Curve=crv, Parameter=0)
eval_2 = EvaluateCurve(Curve=crv, Parameter=0)  # -> Point, Tangent, Angle
len = Length(Curve=crv)
Y_2 = UnitY(Factor=1)
amp = Amplitude(Vector=eval_2.Tangent, Amplitude=len)
item = ListItem(Index=0, Wrap=True)
rectangle = Rectangle(Plane=pframe, XSize="60", YSize="80", Radius=0)  # -> Rectangle, Length
extr = Extrude(Base=rectangle.Rectangle, Direction=amp)
ext = ExtendCurve(Type=0)
cap = CapHoles(Brep=extr)
group = Group(Objects=cap)
