# Grasshopper definition aggr_test.gh (Grasshopper 1.0.8)
# plug-ins: RhinoCodePluginGH

panel = Panel("/Users/petingo/Downloads/wetransfer_ab01_2024-5-28-17-34-56-zip_2024-05-29_0753")
scsy_cpy = ScriptSyncCpython()  # -> stdout, a; inputs select_file: Boolean, packages_2_reload: list of String, x: Double
#   port select_file: Connect a button to open a file dialog to select a cpython file to run.
#   port packages_2_reload: Pass a list with the name of the custom packages you want to reload. This function is useful if you are developing a i.e. PyPI package and you want to reload the submodules after you modified something. The function will reload the package and all its submodules. If you want to reload the package and all its submodules, just pass the package name. If you want to reload only a submodule, pass the package name and the submodule name separated by a dot. If you want to reload multiple submodules, pass the package
#   port x: A generic x input.
#   port stdout: The redirected standard output of the component scriptsync.
#   port a: Generic example output of the component
# ---------- scsy_cpy: Python ----------
from ghpythonlib.componentbase import executingcomponent as component

import System
import System.Drawing
import System.Windows.Forms
import Rhino
import Grasshopper
import Grasshopper as gh
from Grasshopper.Kernel import GH_RuntimeMessageLevel as RML
import sys
import os
import time

import contextlib
import io

import abc
import socket
import threading
import queue
import json

import importlib
import sys

import traceback


class GHThread(threading.Thread, metaclass=abc.ABCMeta):
    """
        A base class for Grasshopper threads.
    """
    def __init__(self, name : str):
        super().__init__(name=name, daemon=False)
        self._component_on_canvas = True
        self._component_enabled = True

    @abc.abstractmethod
    def run(self):
        """ Run the thread. """
        pass

    def _check_if_component_on_canvas(self):
        """ Check if the component is on canvas from thread. """
        def __check_if_component_on_canvas():
            if ghenv.Component.OnPingDocument() is None:
                self._component_on_canvas = False
                return False
            else:
                self._component_on_canvas = True
                return True
        action = System.Action(__check_if_component_on_canvas)
        Rhino.RhinoApp.InvokeOnUiThread(action)

    def _check_if_component_enabled(self):
        """ Check if the component is enabled from thread. """
        def __check_if_component_enabled():
            if ghenv.Component.Locked:
                self._component_enabled = False
            else:
                self._component_enabled = True
        action = System.Action(__check_if_component_enabled)
        Rhino.RhinoApp.InvokeOnUiThread(action)

    def expire_component_solution(self):
        """ Fire the recalculation of the component solution from thread. """
        def __expire_component_solution():
            ghenv.Component.Params.Output[0].ClearData()  # clear the output
            ghenv.Component.ExpireSolution(True)  # expire the component
        action = System.Action(__expire_component_solution)
        Rhino.RhinoApp.InvokeOnUiThread(action)

    def clear_component(self):
        """ Clear the component from thread. """
        def __clear_component():
            ghenv.Component.ClearData()
        action = System.Action(__clear_component)
        Rhino.RhinoApp.InvokeOnUiThread(action)

    def add_runtime_warning(self, exception : str):
        """ Add a warning tab to the component from main thread. """
        action = System.Action(
            lambda: ghenv.Component.AddRuntimeMessage(RML.Warning, exception)
        )
        Rhino.RhinoApp.InvokeOnUiThread(action)

    def add_runtime_error(self, exception : str):
        """ Add an error tab to the component from main thread. """
        action = System.Action(
            lambda: ghenv.Component.AddRuntimeMessage(RML.Error, exception)
        )
        Rhino.RhinoApp.InvokeOnUiThread(action)

    def add_runtime_remark(self, exception : str):
        """ Add a blank tab to the component from main thread. """
        action = System.Action(
            lambda: ghenv.Component.AddRuntimeMessage(RML.Remark, exception)
        )
        Rhino.RhinoApp.InvokeOnUiThread(action)

    @property
    def component_enabled(self):
        self._check_if_component_enabled()
        return self._component_enabled

    @property
    def component_on_canvas(self):
        self._check_if_component_on_canvas()
        return self._component_on_canvas

class ClientThread(GHThread):
    """
    A thread to connect to the VSCode server.
    """
    def __init__(self, vscode_server_ip: str, vscode_server_port: int, name: str,
                 queue_msg: queue.Queue = None, lock_queue_msg: threading.Lock = None,
                 event_fire_msg: threading.Event = None):
        super().__init__(name=name)
        self.vscode_server_ip = vscode_server_ip
        self.vscode_server_port = vscode_server_port
        self.is_connected = False
        self.connect_refresh_rate = 1  # seconds
        self.queue_msg = queue_msg
        self.lock_queue_msg = lock_queue_msg
        self.event_fire_msg = event_fire_msg
        self.client_socket = socket.socket(socket.AF_INET, socket.SOCK_STREAM)

    def run(self):
        """ Run the thread. Send the message to the vscode server."""
        while self.component_on_canvas and self.component_enabled:
            try:
                if not self.is_connected:
                    self.connect_to_vscode_server()
                    self.clear_component()
                    self.expire_component_solution()
                    continue

                self.event_fire_msg.wait()
                self.send_message_from_queue()

            except Exception as e:
                self.add_runtime_warning(f"script-sync::Unkown error from run: {str(e)}")
                self.is_connected = False
                self.client_socket = socket.socket(socket.AF_INET, socket.SOCK_STREAM)

        self.client_socket.close()

    def send_message_from_queue(self):
        with self.lock_queue_msg:
            if self.queue_msg and not self.queue_msg.empty():
                msg = self.queue_msg.get()
                self.queue_msg.task_done()
                self.event_fire_msg.set()
                self.event_fire_msg.clear()
                self.client_socket.send(msg)

    def connect_to_vscode_server(self):
        """ Connect to the VSCode server. """
        while self.component_on_canvas and not self.is_connected:
            try:
                self.client_socket.send(b"")
                self.is_connected = True
            except socket.error:
                try:
                    self.client_socket.connect((self.vscode_server_ip, self.vscode_server_port))
                    self.is_connected = True
                except (ConnectionRefusedError, ConnectionResetError, socket.error) as e:
                    self.handle_connection_error(e)
            finally:
                time.sleep(self.connect_refresh_rate)

    def handle_connection_error(self, e):
        error_messages = {
            ConnectionRefusedError: "script-sync::Connection refused by the vscode",
            ConnectionResetError: "script-sync::Connection was forcibly closed by the vscode",
            socket.error: f"script-sync::Error connecting to the vscode: {str(e)}"
        }
        self.add_runtime_warning(error_messages[type(e)])
        self.is_connected = False if type(e) != socket.error or e.winerror != 10056 else True

class FileChangedThread(GHThread):
    """
        A thread to check if the file has changed on disk.
    """
    def __init__(self,
                path : str,
                name : str
                ):
        super().__init__(name=name)
        self.path = path
        self.refresh_rate = 1000  # milliseconds
        self._on_file_changed = threading.Event()

    def run(self):
        """
            Check if the file has changed on disk.
        """
        last_modified = os.path.getmtime(self.path)
        while self.component_on_canvas and not self._on_file_changed.is_set():
            System.Threading.Thread.Sleep(self.refresh_rate)
            last_modified = self.is_file_modified(last_modified)
        self._on_file_changed.clear()
        return

    def stop(self):
        """ Stop the thread. """
        self._on_file_changed.set()

    def is_file_modified(self, last_modified):
        current_modified = os.path.getmtime(self.path)
        if current_modified != last_modified:
            self.expire_component_solution()
            return current_modified
        return last_modified

class DialogThread(threading.Thread):
    """
        A vanilla thread to open a dialog to select a file. The windows form
        is done in a thread because sometimes it blocks the main thread on which
        the Grasshopper canvas is running.
    """
    def __init__(self):
        threading.Thread.__init__(self)
        self.path = None

    def run(self):
        """
            Open a dialog to select a Python file.
        """
        dialog = System.Windows.Forms.OpenFileDialog()
        dialog.Filter = "Python files (*.py)|*.py"
        dialog.Title = "Select a Python file"
        dialog.InitialDirectory = os.path.dirname("")
        dialog.FileName = ""
        dialog.Multiselect = False
        dialog.CheckFileExists = True
        dialog.CheckPathExists = True
        dialog.RestoreDirectory = True

        if dialog.ShowDialog() == System.Windows.Forms.DialogResult.OK:
            self.path = dialog.FileName
        else:
            raise Exception("script-sync::File not selected")



class ScriptSyncCPy(component):
    def __init__(self):
        super(ScriptSyncCPy, self).__init__()
        self._var_output = []

        self.is_success = False

        self.client_thread_name : str = f"script-sync-client-thread::{ghenv.Component.InstanceGuid}"
        self.vscode_server_ip = "127.0.0.1"
        self.vscode_server_port = 58260
        self.stdout = None
        self.queue_msg = queue.Queue()
        self.queue_msg_lock = threading.Lock()
        self.event_fire_msg = threading.Event()

        self.filechanged_thread_name : str = f"script-sync-fileChanged-thread::{ghenv.Component.InstanceGuid}"
        self.__path_name_table_value = "script-sync::" + "path::" + str(ghenv.Component.InstanceGuid)
        if self.path is None:
            ghenv.Component.Message = "select-script"

    def RemovedFromDocument(self, doc):
        """ Remove the component from the document. """
        if self.client_thread_name in [t.name for t in threading.enumerate()]:
            client_thread = [t for t in threading.enumerate() if t.name == self.client_thread_name][0]
            client_thread.join()
        if self.filechanged_thread_name in [t.name for t in threading.enumerate()]:
            filechanged_thread = [t for t in threading.enumerate() if t.name == self.filechanged_thread_name][0]
            filechanged_thread.join()
        if self.queue_msg is not None:
            self.queue_msg.join()
        if self.queue_msg_lock is not None:
            self.queue_msg_lock.release()
        if self.event_fire_msg is not None:
            self.event_fire_msg.clear()

        # clear the path from the table view
        del self.path

    def init_script_path(self, select_file : bool = False):
        """
            Check if the button is pressed and load/change path script.
            
            :param select_file: A boolean of the button
        """
        # check if button is pressed
        if select_file is True:
            dialog_thread = DialogThread()
            dialog_thread.start()
            dialog_thread.join()  # Wait for the dialog to close
            if dialog_thread.path is not None:
                self.path = dialog_thread.path
            else:
                raise Exception("script-sync::File not selected")

        # fi file is in table view before
        if not os.path.exists(self.path):
            raise Exception("script-sync::File does not exist")
    
    def reload_all_modules(self, directory):
        for filename in os.listdir(directory):
            if filename.endswith('.py') and filename != '__init__.py':
                module_name = filename[:-3]  # remove '.py' from filename
                if module_name in sys.modules:
                    importlib.reload(sys.modules[module_name])

    def safe_exec(self, path, globals, locals, packages_2_reload):
        """
            Execute Python3 code safely. It redirects the output of the code
            to a string buffer 'stdout' to output to the GH component param.
            It is send to the vscode server.
            
            :param path: The path of the file to execute.
            :param globals: The globals dictionary.
            :param locals: The locals dictionary.
            :param packages_2_reload: The list of packages to reload, this is used for custom packages developement.
            installed on the system via an editable pip installation for example.
        """
        try:
            with open(path, 'r') as f:
                # reload the specifyed packages
                if packages_2_reload is not None:
                    if packages_2_reload.__len__() != 0:
                        for package in packages_2_reload:
                            for key in list(sys.modules.keys()):
                                if package in key:
                                    #check that the package must have the attribute __file__ (to avoid reloading pyd)
                                    if hasattr(sys.modules[key], '__file__'):
                                        importlib.reload(sys.modules[key])

                # add the path and sub directories to  the sys path
                path_dir = os.path.dirname(path)
                sub_dirs = []
                for root, dirs, files in os.walk(path_dir):
                    for d in dirs:
                        sub_dirs.append(os.path.join(root, d))
                sys.path.extend([path_dir] + sub_dirs)

                # reload all the modules also of the sub directories
                for root, dirs, files in os.walk(path_dir):
                    for d in dirs:
                        self.reload_all_modules(os.path.join(root, d))
                self.reload_all_modules(path_dir)

                # refresh the python interpreter
                importlib.invalidate_caches()

                # parse the code
                code = compile(f.read(), path, 'exec')
                output = io.StringIO()

                # empty the queue and event
                with self.queue_msg_lock:
                    while not self.queue_msg.empty():
                        self.queue_msg.get()
                        self.queue_msg.task_done()
                self.event_fire_msg.clear()

                # clear all the locals dictionary to avoid that the output variables stick between the component
                # executions when it is recomputed
                outparam = ghenv.Component.Params.Output
                outparam_names = [p.NickName for p in outparam]
                for outp in outparam_names:
                    if outp in locals.keys():
                        del locals[outp]

                # execute the code
                with contextlib.redirect_stdout(output):
                    exec(code, globals, locals)
                locals["stdout"] = output.getvalue()

                # send the msg to the vscode server
                msg_json = json.dumps({"script_path": path,
                                       "guid": str(ghenv.Component.InstanceGuid),
                                       "msg": output.getvalue()})
                msg_json = msg_json.encode('utf-8')
                self.queue_msg.put(msg_json)
                self.event_fire_msg.set()

                # pass the script variables to the GH component outputs
                for outp in outparam_names:
                    if outp in locals.keys():
                        self._var_output.append(locals[outp])
                    else:
                        self._var_output.append(None)

                sys.stdout = sys.__stdout__
            return locals

        except Exception as e:
            # Get the traceback
            tb = traceback.format_exc()

            # Send the error message to the vscode server
            err_json = json.dumps({
                "script_path": path,
                "guid": str(ghenv.Component.InstanceGuid),
                "msg": "err:" + str(e),
                "traceback": tb  # Include the traceback in the JSON
            })
            err_json = err_json.encode('utf-8')
            self.queue_msg.put(err_json)
            self.event_fire_msg.set()

            sys.stdout = sys.__stdout__

            err_msg = f"script-sync::Error in the code: {str(e)}\n{tb}"
            raise Exception(err_msg)

    def RunScript(self,
            select_file: bool,
            packages_2_reload: System.Collections.Generic.List[str],
            x: float):
        """ This method is called whenever the component has to be recalculated it's the solve main instance. """
        self.is_success = False

        # set the path if button is pressed
        self.init_script_path(select_file)

        # file change listener thread
        if self.filechanged_thread_name not in [t.name for t in threading.enumerate()]:
            FileChangedThread(self.path,
                              self.filechanged_thread_name
                              ).start()

        # set up the tcp client to connect to the vscode server
        _ = [print(t.name) for t in threading.enumerate()]
        if self.client_thread_name not in [t.name for t in threading.enumerate()]:
            ClientThread(self.vscode_server_ip,
                        self.vscode_server_port,
                        self.client_thread_name,
                        self.queue_msg,
                        self.queue_msg_lock,
                        self.event_fire_msg
                        ).start()

        # add to the globals all the input parameters of the component (the locals)
        globals().update(locals())

        res = self.safe_exec(self.path, None, globals(), packages_2_reload)
        self.is_success = True
        return

    def is_nested_iterable(self, lst):
        """ Detect if a list is nested. """
        return any(isinstance(i, list) for i in lst)

    def AfterRunScript(self):
        """
            This method is called as soon as the component has finished
            its calculation. It is used to load the GHComponent outputs
            with the values created in the script.
        """
        if not self.is_success:
            return

        outparam = [p for p in ghenv.Component.Params.Output]
        outparam_names = [p.NickName for p in outparam]

        for idx, outp in enumerate(outparam):
            # detect if the output is a list
            if type(self._var_output[idx]) == tuple:
                ghenv.Component.Params.Output[idx].VolatileData.Clear()
                ghenv.Component.Params.Output[idx].AddVolatileDataList(gh.Kernel.Data.GH_Path(0), self._var_output[idx])
            # TODO: increase the number of nested lists they can be handles (max 2 deep for now)
            elif type(self._var_output[idx]) == list:
                ghenv.Component.Params.Output[idx].VolatileData.Clear()
                if self.is_nested_iterable(self._var_output[idx]):
                    nbr_lists_aka_branches = len(self._var_output[idx])
                    for i in range(nbr_lists_aka_branches):
                        ghenv.Component.Params.Output[idx].AddVolatileDataList(gh.Kernel.Data.GH_Path(i), self._var_output[idx][i])
                else:
                    ghenv.Component.Params.Output[idx].AddVolatileDataList(gh.Kernel.Data.GH_Path(0), self._var_output[idx])
            else:
                ghenv.Component.Params.Output[idx].VolatileData.Clear()
                ghenv.Component.Params.Output[idx].AddVolatileData(gh.Kernel.Data.GH_Path(0), 0, self._var_output[idx])
        self._var_output.clear()

    @property
    def path(self):
        """ Get the path of the file from the table view to be sticking between the sessions. """
        table_value = ghenv.Component.OnPingDocument().ValueTable.GetValue(
            self.__path_name_table_value, "not_found"
        )
        if table_value != "not_found":
            return table_value
        else:
            return None

    @path.setter
    def path(self, path : str):
        """ Set the path of the file to the table view to be sticking between the sessions. """
        ghenv.Component.OnPingDocument().ValueTable.SetValue(self.__path_name_table_value, path)

        script_name = os.path.basename(path)
        ghenv.Component.Message = f"{script_name}"

        if self.filechanged_thread_name in [t.name for t in threading.enumerate()]:
            _ = [t for t in threading.enumerate() if t.name == self.filechanged_thread_name][0].stop()

    @path.deleter
    def path(self):
        """ Delete the path of the file from the table view if the object is erased. """
        ghenv.Component.OnPingDocument().ValueTable.DeleteValue(self.__path_name_table_value)
# ---------- end scsy_cpy ----------
py3 = Python3Script(ttool_model_root_path="/Users/petingo/Downloads/TTool dataset")  # -> out, o_ttool_models
# ---------- py3: Python ----------
import os
import Rhino
from glob import glob

import ghpythonlib

ttool_model_paths = glob(os.path.join(ttool_model_root_path, "*"))

# ttool_model_obj_paths = []

ttool_models = {}

for path in ttool_model_paths:
    if path.endswith(".zip"):
        continue

    model_path = os.path.join(path, "model.obj")
    model_name = os.path.basename(path)

    model_obj = ghpythonlib.components.Import3DM(model_path, "*", "*")

    ttool_models[model_name] = model_obj

o_ttool_models = (ttool_models,)
# ---------- end py3 ----------
py3_2 = Python3Script(root_path=panel, exp_id="AB01")  # -> out, o_event_log, o_event_log_index
# ---------- py3_2: Python ----------
# r: numpy

import os

import Grasshopper
import Grasshopper as gh
from Grasshopper.Kernel import GH_RuntimeMessageLevel as RML
from ghpythonlib.componentbase import executingcomponent as component

import Rhino
import Rhino.Geometry as rg
import zipfile

from glob import glob

import numpy as np

def convert_log_pose_to_transform_matrix(log: list):
    """
    Convert log pose ([t.x, t.y, t.z, q.x, q.y, q.z, q.w]) to transform matrix
    """
    t = np.array(log[:3])
    q = np.array(log[3:])
    q = q / np.linalg.norm(q)
    R = np.array([
        [1 - 2*q[1]*q[1] - 2*q[2]*q[2], 2*q[0]*q[1] - 2*q[2]*q[3], 2*q[0]*q[2] + 2*q[1]*q[3]],
        [2*q[0]*q[1] + 2*q[2]*q[3], 1 - 2*q[0]*q[0] - 2*q[2]*q[2], 2*q[1]*q[2] - 2*q[0]*q[3]],
        [2*q[0]*q[2] - 2*q[1]*q[3], 2*q[1]*q[2] + 2*q[0]*q[3], 1 - 2*q[0]*q[0] - 2*q[1]*q[1]]
    ])
    return np.vstack([np.hstack([R, t.reshape(-1, 1)]), np.array([0, 0, 0, 1])])

all_paths = glob(os.path.join(root_path, "*"))

exp_folders = []
for path in all_paths:
    basename = os.path.basename(path)

    if basename.endswith(".zip"):
        with zipfile.ZipFile(path, 'r') as zip_ref:
            zip_ref.extractall(root_path)
        path = path[:-4]

    if basename.startswith(exp_id):
        exp_folders.append(path)
exp_folders.sort()

events = [
    "SLAM",
    "TTool-head",
    "TTool-pose",
    "ACIM-activate-component",
    "ACIM-component-status",
    "ACIM-transform"
]

event_log = {}
event_log_index = {}

for e in events:
    event_log[e] = {}
    event_log_index[e] = []

current_frame = 0

for i, path in enumerate(exp_folders):
    log_filepath = os.path.join(path, "log.txt")

    with open(log_filepath) as f:
        start_flag = False

        for line in f:
            # start flag
            if "[Init]" in line:
                start_flag = True
                continue
            
            if not start_flag:
                continue
            
            # frame number
            if line[0] == '#':
                current_frame += 1
                continue
            
            # others events
            arr = line.split(' ')
            event_type = arr[0]

            # for ACIM-transform, we assume that it is initialized at the first log sequence
            if i == 0 and event_type == "ACIM-transform":
                event_log["ACIM-transform"][current_frame] = convert_log_pose_to_transform_matrix(list(map(float, arr[1:])))
                event_log_index["ACIM-transform"].append(current_frame)

            if event_type == "SLAM":
                event_log["SLAM"][current_frame] = convert_log_pose_to_transform_matrix(list(map(float, arr[1:])))
                event_log_index["SLAM"].append(current_frame)

            elif event_type == "TTool-head":
                event_log["TTool-head"][current_frame] = arr[1]
                event_log_index["TTool-head"].append(current_frame)
            elif event_type == "TTool-pose":
                event_log["TTool-pose"][current_frame] = convert_log_pose_to_transform_matrix(list(map(float, arr[2:])))
                event_log_index["TTool-pose"].append(current_frame)

            elif event_type == "ACIM-activate-component":
                event_log["ACIM-activate-component"][current_frame] = arr[1]
                event_log_index["ACIM-activate-component"].append(current_frame)
            elif event_type == "ACIM-component-status":
                event_log["ACIM-component-status"][current_frame] = (arr[1], arr[2])
                event_log_index["ACIM-component-status"].append(current_frame)
    
    current_frame += 1

o_event_log = [event_log]
o_event_log_index = [event_log_index]
# ---------- end py3_2 ----------
py3_3 = Python3Script(x=py3.o_ttool_models)  # -> out, a
# ---------- py3_3: Python ----------
x = x[0]
a = x["brad_point_drill_bit_20_150"]
# ---------- end py3_3 ----------
